# Dynamo graph 01_TEXT_UPPERCASE_ROOM_TAG.dyn (Dynamo 0.9.0.3067)

categories = Categories("Rooms")
all_elements_of_category = ElementsOfCategory(categories)
code_block = CodeBlock { "Name"; }
getParameterValueByName = Element.GetParameterValueByName(element=all_elements_of_category, parameterName=code_block)
toUpper = String.ToUpper(getParameterValueByName)
setParameterByName = Element.SetParameterByName(element=all_elements_of_category, parameterName=code_block, value=toUpper)
