# Dynamo graph 02 Delete parameters.dyn (Dynamo 2.19.3.6394)

python_script = Python()  # CPython3; unwired: IN[0]
# ---------- python_script.python (65 lines) ----------
import clr

# Import Revit API
clr.AddReference("RevitAPI")
clr.AddReference("RevitAPIUI")
clr.AddReference("RevitServices")

from Autodesk.Revit.DB import *
from RevitServices.Persistence import DocumentManager
from RevitServices.Transactions import TransactionManager

# الحصول على المستند الحالي
doc = DocumentManager.Instance.CurrentDBDocument

# قائمة بأسماء المعاملات المراد حذفها
parameters_to_remove = [ "02-Building Name" ,"03-Filed Name" ,"04-Revision" ,"05-Revison Number"

,"LERA - DRAWING LIST" ,"Cont. Code"

,"PHASE" ,"REV NO" ,"REVISION DATE" ,"Revision" ,"SCALE" ,"Manual Scale"
,"Sheet Group"  ,"REVISION Stamp" ,"REVISION Type" ,"Revision Sheet text"
,"SHEETNUMBER PREFIX"
,"sketch Numper "
,"F+P Zone Group" ,"F+P Discipline","F+P Zone Group"  ,"F+P Discipline Group" ,"F+P Drawing View" ,"F+P Project Number" ,"F+P File Name Convention" ,"F+P Content Naming Convention" 
,"CURRENT SHEET COUNT" ,"TOTAL SHEET COUNT"  ,"ROOM / LOCATION / DEPT." 

,"DRAWING APPROVAL DATE"
,"DRAWING APPROVAL NAME" ,"DRAWING APPROVER NAME" 
,"Stage" , "LERA - DRAWING LIST" , 
"Sheet Page_L" , "View Group " ,  


"REVISION DATE" ,
"Refer_Revision" ,

"Project Line 1", "Project Line 2", "Project Line 3", "Project Line 4", "BIM Manager", "BIM Coordinator","Template Version" ,"Client Name 1", "Client Name 2", "Client Name 3", "Client Name 4", "BIM Manager", "Model Status",  "Revit Version",   "Model Issue Date",  "Model Issue Consultant Name","Model Revision"  ,"Model Name"  , "Training Resource", "Template Release Date", "Template Release Version","Audit Date" ,"Cad Links","Revit Version"  ,"Project Status" ,"Sheet Package"  ,"Sheet Package 2","Submission or Package Title" ,"Submission or Package Title 2","Project Information Manager" ,"Task Information Manager" ,"Model Issue Reason"   ,"Design Consultant"  ,"Design Discipline"  ,"Design Disciplint" ,"Design Options"     ,"Design Stage"   ,"DWG.DESC.1" ,"DWG.DESC.2"  ,"Revit Links"  ,"Series Desciption"   ,"File Size"  ,"Type of Audit"   ,"Path to Keynote Table" ,"Subcateries"   ,"Warning - Keynoting"  ,"Warning - Geometry"   ,"Warning - Constraints"  ,"Warning - Railings"  ,"Warning - Other"  ,"Warning - Hosting" ,"Warning" ,"File Creation Date"  ,"Paths to Images"   ,"Paths to CAD Links" ,"Paths to Revit Links"   ,"Model Groups"  ,"Model Elements"  ,"Sheet Code" ,"Revit Version"  ,"F+P Sheet Package" ,"F+P Sheet Sub-Code" ,"01-Title"  ,"F+P Building Number","F+P Sub-discipline Group","F+P View Group","F+P View SubGroup"  ,"Construction Phase" ,"Element Status"  ,"LERA - Sheet Series" ,"LERA - Sheet Groups"  ,"Sheet Group"  ,"Sheet Owner" ,"Sheet Page" ,"TES"  ,"View Owner" ,"View Group" ,"Refer_Date","Sheet Title Line 1","Sheet Title Line 2","Sheet Title Line 3","Sheet Title Line 4"  
,"Sketch Date"  ,"sketch Number"
,"View Group", "Youtube clip" 

, "VERSION"  , "Sheet Number-Prefix" , "Sheet Type"  , "SHEETNUMBER PREFIX" , "Shared_DrawingNo" 

,"View Reference BL","View Reference BR" ,"View Reference LB" ,"View Reference LT" ,"View Reference RB" ,"View Reference RT" ,"View Reference TL" ,"View Reference TR"
  ,"Ø500mm Flexible"
,"Ø450mm Flexible" ,"Ø400mm Flexible" ,"Ø350mm Flexible" ,"Ø300mm Flexible" ,"Ø500mm Flexible" ,"Ø250mm Flexible","Ø150mm Flexible"
]

# بدء معاملة (Transaction)
TransactionManager.Instance.EnsureInTransaction(doc)

# البحث عن Project Parameters وحذفها
project_params = doc.ParameterBindings
iterator = project_params.ForwardIterator()

while iterator.MoveNext():
    definition = iterator.Key
    name = definition.Name
    if name in parameters_to_remove:
        try:
            project_params.Remove(definition)
            print(f"تم حذف المعامل: {name}")
        except Exception as e:
            print(f"تعذر حذف المعامل: {name}. الخطأ: {e}")

# إنهاء المعاملة
TransactionManager.Instance.TransactionTaskDone()
# ----------------------------------------
python_script_2 = Python()  # CPython3; unwired: IN[0]
# ---------- python_script_2.python (37 lines) ----------
# استيراد مكتبات Revit وDynamo
import clr
clr.AddReference('RevitServices')
from RevitServices.Persistence import DocumentManager
from RevitServices.Transactions import TransactionManager

clr.AddReference('RevitAPI')
from Autodesk.Revit.DB import *

# الحصول على المستند الحالي
doc = DocumentManager.Instance.CurrentDBDocument

# إنشاء قائمة لتجميع المعلمات غير المرتبطة
parameters_to_delete = []

# الوصول إلى خريطة ParameterBindings
binding_map = doc.ParameterBindings
iterator = binding_map.ForwardIterator()
iterator.Reset()

# التحقق من كل Project Parameter
while iterator.MoveNext():
    param_def = iterator.Key  # تعريف المعلمة
    binding = iterator.Current  # الربط الخاص بالمعلمة
    
    # التحقق إذا كانت المعلمة غير مرتبطة بأي فئة
    if binding is not None and (binding.Categories is None or binding.Categories.Size == 0):
        parameters_to_delete.append(param_def)  # إضافة المعلمة إلى قائمة الحذف

# بدء معاملة لحذف المعلمات
TransactionManager.Instance.EnsureInTransaction(doc)
for param_def in parameters_to_delete:
    binding_map.Remove(param_def)  # حذف المعلمة
TransactionManager.Instance.TransactionTaskDone()

# إخراج أسماء المعلمات التي تم حذفها
OUT = f"تم حذف {len(parameters_to_delete)} معلمة غير مرتبطة: {[p.Name for p in parameters_to_delete]}"
# ----------------------------------------
python_script_3 = Python()  # CPython3; unwired: IN[0]
# ---------- python_script_3.python (33 lines) ----------
# استيراد مكتبات Revit وDynamo
import clr
clr.AddReference('RevitServices')
from RevitServices.Persistence import DocumentManager

clr.AddReference('RevitAPI')
from Autodesk.Revit.DB import *

# الحصول على المستند الحالي
doc = DocumentManager.Instance.CurrentDBDocument

# الوصول إلى خريطة ParameterBindings
binding_map = doc.ParameterBindings
iterator = binding_map.ForwardIterator()
iterator.Reset()

# قائمة لتخزين تفاصيل المعلمات
parameters_info = []

# التحقق من جميع Project Parameters
while iterator.MoveNext():
    param_def = iterator.Key  # تعريف المعلمة
    binding = iterator.Current  # الربط الخاص بالمعلمة
    categories = binding.Categories if binding else None
    category_names = [cat.Name for cat in categories] if categories else []
    
    parameters_info.append({
        "Name": param_def.Name,
        "Categories": category_names
    })

# إخراج تفاصيل المعلمات
OUT = parameters_info
# ----------------------------------------
