# Dynamo graph 02.1 Room Dimensions.dyn "Room Dimensions_script" (Dynamo 2.10.1.3976)
# packages: Data-Shapes 2022.2.102

# group: Preparing Inputs
code_block = CodeBlock { "Rooms"; "Please Select the Rooms"; }
categories = Categories("OST_Rooms")
selectmodelelements_data = Custom[SelectModelElements Data](InputName=code_block.out0, ButtonText=code_block.out1, CategoryFilter=categories)  # package Data-Shapes; Creates a Revit element selection input for UI.MultipleInputForm++ . Check out www.data-shapes.net for more infos!
code_block_2 = CodeBlock { "Linked Rooms"; "Please Select the Linked Rooms"; }
selectlinkedelement_s_data = Custom[SelectLinkedElement(s) Data](InputName=code_block_2.out0, ButtonText=code_block_2.out1)  # package Data-Shapes; Create a button input for UI.MultipleInputForm++ that allows to select elements in à linked document. See www.data-shapes.net for more infos!
code_block_3 = CodeBlock { "Dimensions Limits"; }
code_block_4 = CodeBlock { ["Walls' Center Line", "Walls' Finish"]; [true,false]; 0; }
dropdown_data = Custom[DropDown Data](InputName=code_block_3, Keys=code_block_4.out0, Values=code_block_4.out1, DefaultValueIndex=code_block_4.out2)  # package Data-Shapes; Create data for DropDown input in UI.MultiInputForm ++ . Check out www.data-shapes.net for more infos.
list_create = List.Create(item0=selectmodelelements_data, item1=selectlinkedelement_s_data, item2=dropdown_data)

# group: Data Shape Preparation
code_block_5 = CodeBlock { "Rooms Dimensions"; }
file_path = Filename("..\..\..\..\..\..\..\Logo.png")
code_block_6 = CodeBlock { "RUN"; }
boolean = BoolSelector(true)
code_block_7 = CodeBlock { "Cancel"; }
code_block_8 = CodeBlock { 1000; 500; 200; }
multipleinputform = Custom[MultipleInputForm ++](Description_optional=code_block_5, Logo_optional=file_path, ButtonText_optional=code_block_6, Inputs=list_create, Toggle=boolean, CancelButtonText_optional=code_block_7, MaxHeight_optional=code_block_8.out0, Width_optional=code_block_8.out1, LabelWidth_optional=code_block_8.out2)  # package Data-Shapes; Create a form with multiple inputs. see www.data-shapes.net for tutorials and infos!

# group: Distribute the Inputs
code_block_9 = CodeBlock { 0; 1; 2; }
getItemAtIndex = List.GetItemAtIndex(list=multipleinputform.User_Inputs, index=code_block_9.out0)
getItemAtIndex_2 = List.GetItemAtIndex(list=multipleinputform.User_Inputs, index=code_block_9.out1)
getItemAtIndex_3 = List.GetItemAtIndex(list=multipleinputform.User_Inputs, index=code_block_9.out2)

python_script = Python(IN[0]=getItemAtIndex, IN[1]=getItemAtIndex_2, IN[2]=getItemAtIndex_3)  # IronPython2
# ---------- python_script.python (484 lines) ----------
import clr

clr.AddReference('RevitAPI')
from Autodesk.Revit.DB import *
from Autodesk.Revit.DB.Structure import *

clr.AddReference('RevitAPIUI')
from Autodesk.Revit.UI import *

clr.AddReference('System')
from System.Collections.Generic import List

clr.AddReference('RevitNodes')
import Revit
clr.ImportExtensions(Revit.GeometryConversion)
clr.ImportExtensions(Revit.Elements)

clr.AddReference('RevitServices')
import RevitServices
from RevitServices.Persistence import DocumentManager
from RevitServices.Transactions import TransactionManager

doc = DocumentManager.Instance.CurrentDBDocument
uidoc=DocumentManager.Instance.CurrentUIApplication.ActiveUIDocument

#Active View
AV=doc.ActiveView
result=IN[2]
#Do some action in a Transaction
TransactionManager.Instance.EnsureInTransaction(doc)

# #Dimension From Wall Centerlines?
# TD=TaskDialog("Dimensions")
# TD.Title="Dimensions Inquire"
# TD.MainIcon=TaskDialogIcon.TaskDialogIconShield
# TD.MainInstruction = "Do you want dimensions from walls' center lines?"
# TD.CommonButtons = TaskDialogCommonButtons.Yes | TaskDialogCommonButtons.No
# #TD.ExtraCheckBoxText="Isolate Failed Columns?"
# result=TD.Show()

#Preparing Inputs
if not isinstance(IN[0],list):
	Rooms1 = UnwrapElement([IN[0]])
else:
	Rooms1 = UnwrapElement(IN[0])

if not isinstance(IN[1],list):
	Rooms2 = UnwrapElement([IN[1]])
else:
	Rooms2 = UnwrapElement(IN[1])

Rooms=[Rooms1,Rooms2]
Rooms=[item for sublist in Rooms for item in sublist]
#Boundaries Option
settings = AreaVolumeSettings.GetAreaVolumeSettings(doc)
options  = SpatialElementBoundaryOptions()
b_option = settings.GetSpatialElementBoundaryLocation(SpatialElementType.Room)
options.SpatialElementBoundaryLocation = b_option

FailedRooms=[]
for R in Rooms:
	try:
		AllCurves=[]
		Lista=[]
		#Room Location Point
		RoomLocation = R.Location.Point
		Ldoc=R.Document
		InitialBs=R.GetBoundarySegments(options)[0]
		InitialCs=[i.GetCurve() for i in InitialBs]
		InitialCsD=[i.GetCurve().ToProtoType() for i in InitialBs]
		InitialVs=[i.Direction for i in InitialCs]
		InitialEs=[Ldoc.GetElement(i.ElementId) for i in InitialBs]
		InitialEIds=[i.ElementId for i in InitialBs]

		Boundaries, Curves, CurvesD, Vectors ,Elements ,ElementIds= ([] for i in range(6))

		for i,A in enumerate(InitialEs):
			if A!=None:
				E, C, CD, V ,B ,EI= ([] for i in range(6))
				if A.Category.Name=="Walls":
					Elements.append(A)
					Boundaries.append(InitialBs[i])
					Curves.append(InitialCs[i])
					CurvesD.append(InitialCsD[i])
					Vectors.append(InitialVs[i])
					ElementIds.append(InitialEIds[i])
				elif A.Category.Name=="<Room Separation>":
					Elements.append(A)
					Boundaries.append(InitialBs[i])
					Curves.append(InitialCs[i])
					CurvesD.append(InitialCsD[i])
					Vectors.append(InitialVs[i])
					ElementIds.append(InitialEIds[i])
				elif A.Category.Name=="RVT Links":
					linkDoc = A.GetLinkDocument()
		 			CheckElement = linkDoc.GetElement(InitialBs[i].LinkElementId)
		 			if CheckElement.Category.Name=="Walls":
		 				Elements.append(A)
						Boundaries.append(InitialBs[i])
						Curves.append(InitialCs[i])
						CurvesD.append(InitialCsD[i])
						Vectors.append(InitialVs[i])
						ElementIds.append(InitialEIds[i])

		Boundaries0, Curves0, CurvesD0, Vectors0 ,Elements0 ,ElementIds0= ([] for i in range(6))
		
		for i,j in enumerate(Vectors):
			if not i in Lista:
				Lista.append(i)
				Bs0, Cs0, CsD0, Vs0 ,Es0 ,EIds0= ([] for i in range(6))
				C=[]
				for n,m in enumerate(Vectors):
					if not n in Lista and j.CrossProduct(m).IsZeroLength() and n!=i:
						Lista.append(n)
						if i in C:
							Bs0.append(Boundaries[n])
							Cs0.append(Curves[n])
							CsD0.append(CurvesD[n])
							Vs0.append(Vectors[n])
							Es0.append(Elements[n])
							EIds0.append(ElementIds[n])
							C.append(n)
						else:
							Bs0.append(Boundaries[i])
							Cs0.append(Curves[i])
							CsD0.append(CurvesD[i])
							Vs0.append(Vectors[i])
							Es0.append(Elements[i])
							EIds0.append(ElementIds[i])
							C.append(i)
							Bs0.append(Boundaries[n])
							Cs0.append(Curves[n])
							CsD0.append(CurvesD[n])
							Vs0.append(Vectors[n])
							Es0.append(Elements[n])
							EIds0.append(ElementIds[n])
							C.append(n)
				if not C:
					Bs0.append(Boundaries[i])
					Cs0.append(Curves[i])
					CsD0.append(CurvesD[i])
					Vs0.append(Vectors[i])
					Es0.append(Elements[i])
					EIds0.append(ElementIds[i])
					C.append(i)
				
				Boundaries0.append(Bs0)
				Curves0.append(Cs0)
				CurvesD0.append(CsD0)
				Vectors0.append(Vs0)
				Elements0.append(Es0)
				ElementIds0.append(EIds0)
		
		Boundaries1, Curves1, CurvesD1, Vectors1 ,Elements1 ,ElementIds1= ([] for i in range(6))
		for i,j in enumerate(Elements0):
			E1, C1, CD1, V1 ,B1 ,EI1= ([] for i in range(6))
			if i!=None:
				for n,m in enumerate(j):
					if m!=None:
						B1.append(Boundaries0[i][n])
						E1.append(Elements0[i][n])
						C1.append(Curves0[i][n])
						CD1.append(CurvesD0[i][n])
						V1.append(Vectors0[i][n])
						EI1.append(ElementIds0[i][n])
				Boundaries1.append(B1)
				Curves1.append(C1)
				CurvesD1.append(CD1)
				Vectors1.append(V1)
				Elements1.append(E1)
				ElementIds1.append(EI1)
		Ds=[]
		Boundaries2, Curves2, CurvesD2, Vectors2 ,Elements2 ,ElementIds2= ([] for i in range(6))
		for i,j in enumerate(Curves1):
			if j:
				Dist=[]
				E2, C2, CD2, V2 ,B2 ,EI2= ([] for i in range(6))
				B2.append(Boundaries1[i][0])
				E2.append(Elements1[i][0])
				C2.append(Curves1[i][0])
				CD2.append(CurvesD1[i][0])
				V2.append(Vectors1[i][0])
				EI2.append(ElementIds1[i][0])
				for n,m in enumerate(j):
					if n==0:
						pass
					else:
						Pt1= j[0].GetEndPoint(0)
						Pt2= j[0].GetEndPoint(1)
						Pt3= XYZ(Pt1.X,Pt1.Y,Pt1.Z+2)
						Pl=Plane.CreateByThreePoints(Pt1,Pt2,Pt3)
						ProjectionDistance=round(Pl.Project(m.Evaluate(0.5,True))[1],1)
						if ProjectionDistance in Dist or ProjectionDistance==0 or ProjectionDistance<0.0984252:
							pass
						else:
							B2.append(Boundaries1[i][n])
							E2.append(Elements1[i][n])
							C2.append(Curves1[i][n])
							CD2.append(CurvesD1[i][n])
							V2.append(Vectors1[i][n])
							EI2.append(ElementIds1[i][n])
							Dist.append(ProjectionDistance)
			
				Ds.append(Dist)

				Boundaries2.append(B2)
				Curves2.append(C2)
				CurvesD2.append(CD2)
				Vectors2.append(V2)
				Elements2.append(E2)
				ElementIds2.append(EI2)

		References=[]
		for i,j in enumerate(Elements2):
			TargetReferences=[]
			for n,m in enumerate(j):
				if m.Category.Name=="<Room Separation>":
					if not m.Document.IsLinked:
						TargetReferences.append(Reference(m))
					
					# if m.Document.IsLinked:
					# 	Ldoc= m.Document
					# 	WallUID= m.UniqueId
					# 	HashCode= m.Document.GetHashCode()
					# 	AllLinks=FilteredElementCollector(doc).OfClass(RevitLinkInstance)
					# 	AllLinksList=[i for i in AllLinks]
					# 	HashCodes=[L.GetLinkDocument().GetHashCode() for L in  AllLinksList]
					# 	index= HashCodes.index(HashCode)
					# 	RvtLink=AllLinksList[index]

					# 	def parseLinkedReference(doc, linkedRef):
					# 		reps = linkedRef.ConvertToStableRepresentation(doc).split(':')      
					# 		res = ''
					# 		first=True        
					# 		for i, s in enumerate(reps):
					# 			t = s
					# 			if "RVTLINK" in s:
					# 				if(i<len(reps)-1):
					# 					if reps[i+1]=="0":
					# 						t = "RVTLINK"
					# 					else:
					# 						t = "0:RVTLINK"
					# 				else:
					# 					t = "0:RVTLINK"
					# 			if not first:
					# 				res = res + ":" + t
					# 			else:
					# 				res = t
					# 				first = False          
					# 		ref = Reference.ParseFromStableRepresentation(doc,res)
					# 		return ref
					# 	KILWA=Reference(m).CreateLinkReference(RvtLink)
					# 	TargetReferences.append(parseLinkedReference(doc,KILWA))

				elif m.Category.Name=="Walls":
					if not m.Document.IsLinked:
						if m.WallType.Kind==WallKind.Curtain:
							TargetReferences.append(Reference(m))
						elif not result:
							t=1
							#Interior Face
							SFIR=HostObjectUtils.GetSideFaces(m,ShellLayerType.Interior)[0]
							SFIG= m.GetGeometryObjectFromReference(SFIR)
							#Converting To Plan
							IP=Plane.CreateByNormalAndOrigin(SFIG.FaceNormal,SFIG.Origin)
							#Distance From the Interior Face To the Room Location Point
							PDI= IP.Project(Curves2[i][n].Evaluate(0.5,True))[1]

							#Exterior Face
							SFER=HostObjectUtils.GetSideFaces(m,ShellLayerType.Exterior)[0]
							SFEG= m.GetGeometryObjectFromReference(SFER)
							#Converting To Plan
							EP=Plane.CreateByNormalAndOrigin(SFEG.FaceNormal,SFEG.Origin)
							#Distance From the Exterior Face To the Room Location Point
							PDE= EP.Project(Curves2[i][n].Evaluate(0.5,True))[1]
							#JJ.append(Curves2[i][n].Evaluate(0.5,True).ToPoint())
							#Determining the Face That Faces The Room
							if PDI<PDE:
								TargetReferences.append(SFIR)
							else:
								TargetReferences.append(SFER)
						elif result:
							TargetReferences.append(Reference(m))
							PP=1
					
					elif m.Document.IsLinked:
						Ldoc= m.Document
						WallUID= m.UniqueId
						HashCode= m.Document.GetHashCode()
						AllLinks=FilteredElementCollector(doc).OfClass(RevitLinkInstance)
						AllLinksList=[i for i in AllLinks]
						HashCodes=[L.GetLinkDocument().GetHashCode() for L in  AllLinksList]
						index= HashCodes.index(HashCode)
						RvtLink=AllLinksList[index]
						if not result:
							RefString1= str.Format("{0}:{1}:{2}",WallUID,"5",5)
							Ref1= Reference.ParseFromStableRepresentation(Ldoc,RefString1)
							inkedReference1 = Ref1.CreateLinkReference(RvtLink)
							reps1 = inkedReference1.ConvertToStableRepresentation(doc).split(':') 
							res1 = ''
							first=True 
							for k, s in enumerate(reps1):
									t = s
									if "RVTLINK" in s:
										if(k<len(reps1)-1):
											if reps1[k+1]=="0":
												t = "RVTLINK"
											else:
												t = "0:RVTLINK"
										else:
											t = "0:RVTLINK"
									if not first:
										res1 = res1 + ":" + t
									else:
										res1 = t
										first = False

							LRef1 = inkedReference1.ParseFromStableRepresentation(doc,res1)

							TargetReferences.append(LRef1)

							RefString2= str.Format("{0}:{1}:{2}",WallUID,"5",6)
							Ref2= Reference.ParseFromStableRepresentation(Ldoc,RefString2)
							inkedReference2 = Ref2.CreateLinkReference(RvtLink)
							reps2 = inkedReference2.ConvertToStableRepresentation(doc).split(':') 
							res2 = ''
							first=True 
							for k, s in enumerate(reps2):
									t = s
									if "RVTLINK" in s:
										if(k<len(reps2)-1):
											if reps2[k+1]=="0":
												t = "RVTLINK"
											else:
												t = "0:RVTLINK"
										else:
											t = "0:RVTLINK"
									if not first:
										res2 = res2 + ":" + t
									else:
										res2 = t
										first = False

							LRef2 = inkedReference2.ParseFromStableRepresentation(doc,res2)
							#TargetReferences.append(LRef2)

							m= Wall

						else:
							RefString2= str.Format("{0}:{1}:{2}",WallUID,"5",1)
							Ref2= Reference.ParseFromStableRepresentation(Ldoc,RefString2)
							inkedReference2 = Ref2.CreateLinkReference(RvtLink)
							reps2 = inkedReference2.ConvertToStableRepresentation(doc).split(':') 
							res2 = ''
							first=True 
							for k, s in enumerate(reps2):
									t = s
									if "RVTLINK" in s:
										if(k<len(reps2)-1):
											if reps2[k+1]=="0":
												t = "RVTLINK"
											else:
												t = "0:RVTLINK"
										else:
											t = "0:RVTLINK"
									if not first:
										res2 = res2 + ":" + t
									else:
										res2 = t
										first = False

							LRef2 = inkedReference2.ParseFromStableRepresentation(doc,res2)
							TargetReferences.append(LRef2)
				elif m.Category.Name=="RVT Links":

					RvtLink= m
					linkDoc = m.GetLinkDocument()
		 			Wall = linkDoc.GetElement(Boundaries2[i][n].LinkElementId)
		 			if Wall.Category.Name=="Walls":
			 			Ldoc= Wall.Document
						WallUID= Wall.UniqueId

						if not result:
							RefString1= str.Format("{0}:{1}:{2}",WallUID,"5",5)
							Ref1= Reference.ParseFromStableRepresentation(Ldoc,RefString1)
							inkedReference1 = Ref1.CreateLinkReference(RvtLink)
							reps1 = inkedReference1.ConvertToStableRepresentation(doc).split(':') 
							res1 = ''
							first=True 
							for k, s in enumerate(reps1):
									t = s
									if "RVTLINK" in s:
										if(k<len(reps1)-1):
											if reps1[k+1]=="0":
												t = "RVTLINK"
											else:
												t = "0:RVTLINK"
										else:
											t = "0:RVTLINK"
									if not first:
										res1 = res1 + ":" + t
									else:
										res1 = t
										first = False

							LRef1 = inkedReference1.ParseFromStableRepresentation(doc,res1)

							TargetReferences.append(LRef1)

							RefString2= str.Format("{0}:{1}:{2}",WallUID,"5",6)
							Ref2= Reference.ParseFromStableRepresentation(Ldoc,RefString2)
							inkedReference2 = Ref2.CreateLinkReference(RvtLink)
							reps2 = inkedReference2.ConvertToStableRepresentation(doc).split(':') 
							res2 = ''
							first=True 
							for k, s in enumerate(reps2):
									t = s
									if "RVTLINK" in s:
										if(k<len(reps2)-1):
											if reps2[k+1]=="0":
												t = "RVTLINK"
											else:
												t = "0:RVTLINK"
										else:
											t = "0:RVTLINK"
									if not first:
										res2 = res2 + ":" + t
									else:
										res2 = t
										first = False

							LRef2 = inkedReference2.ParseFromStableRepresentation(doc,res2)
							#TargetReferences.append(LRef2)

							m= Wall

						else:
							RefString2= str.Format("{0}:{1}:{2}",WallUID,"5",1)
							Ref2= Reference.ParseFromStableRepresentation(Ldoc,RefString2)
							inkedReference2 = Ref2.CreateLinkReference(RvtLink)
							reps2 = inkedReference2.ConvertToStableRepresentation(doc).split(':') 
							res2 = ''
							first=True 
							for k, s in enumerate(reps2):
									t = s
									if "RVTLINK" in s:
										if(k<len(reps2)-1):
											if reps2[k+1]=="0":
												t = "RVTLINK"
											else:
												t = "0:RVTLINK"
										else:
											t = "0:RVTLINK"
									if not first:
										res2 = res2 + ":" + t
									else:
										res2 = t
										first = False

							LRef2 = inkedReference2.ParseFromStableRepresentation(doc,res2)
							TargetReferences.append(LRef2)
					else:
						pass
			References.append(TargetReferences)
		
		Refs=[]
		for i,j in enumerate(References):
			RefArray=ReferenceArray()
			for n,m in enumerate(j):
				RefArray.Append(m)
			Normal=Vectors2[i][0].CrossProduct(XYZ.BasisZ)
			Pt1= Transform.CreateTranslation(Vectors2[i][0]).OfPoint(RoomLocation)
			Pt2= Transform.CreateTranslation(Normal).OfPoint(Pt1)
			DLine=Line.CreateBound(Pt1,Pt2)
			try:
				Dim=doc.Create.NewDimension(AV,DLine,RefArray)
			except:
				pass
			Refs.append(RefArray)
	except:
		FailedRooms.append(R.Id)
TransactionManager.Instance.TransactionTaskDone()

OUT = FailedRooms
# ----------------------------------------
