# Dynamo graph 03  Mark Value Warnings.dyn "03 Mark Value Warnings" (Dynamo 2.6.1.8786)
# packages: ParametricMonkey 1.3.6

# group: elements have dublicate
all_warnings_of_type = AllWarningsOfType("Elements have duplicate \"Number\" values. ")

description = Warning.Description(warning=all_warnings_of_type)
getFailingElements = Warning.GetFailingElements(warning=all_warnings_of_type)
python_script = Python(IN[0]=description, IN[1]=getFailingElements)
# ---------- python_script.python (39 lines) ----------
import clr

clr.AddReference('RevitAPI')
from Autodesk.Revit.DB import *
from Autodesk.Revit.DB.Structure import *

clr.AddReference('RevitAPIUI')
from Autodesk.Revit.UI import *

clr.AddReference('System')
from System.Collections.Generic import List

clr.AddReference('RevitNodes')
import Revit
clr.ImportExtensions(Revit.GeometryConversion)
clr.ImportExtensions(Revit.Elements)

clr.AddReference('RevitServices')
import RevitServices
from RevitServices.Persistence import DocumentManager
from RevitServices.Transactions import TransactionManager

doc = DocumentManager.Instance.CurrentDBDocument
uidoc=DocumentManager.Instance.CurrentUIApplication.ActiveUIDocument

F=[]
#Preparing input from dynamo to revit
Desc = IN[0]
elements = IN[1]

for D,E in zip(Desc,elements):
	if "Mark" in D and not "Type" in D:
		F.append(E)
#Do some action in a Transaction
TransactionManager.Instance.EnsureInTransaction(doc)

TransactionManager.Instance.TransactionTaskDone()

OUT = F
# ----------------------------------------
code_block = CodeBlock { "Mark"; }
code_block_2 = CodeBlock { "Mark"; }
getParameterValueByName = Element.GetParameterValueByName(element=python_script, parameterName=code_block_2)
length = String.Length(str=getParameterValueByName)
code_block_3 = CodeBlock { 1; }
count = List.Count(list=getParameterValueByName@L2)
range = Range(start=code_block_3, end=count)
code_block_4 = CodeBlock(L=range) { -L; }
string_from_object = FromObject(obj=code_block_4)
insert = String.Insert(str=getParameterValueByName, index=length, toInsert=string_from_object)
setParameterByName = Element.SetParameterByName(element=python_script, parameterName=code_block, value=insert)
python_script_2 = Python(IN[0]=description, IN[1]=getFailingElements)
# ---------- python_script_2.python (39 lines) ----------
import clr

clr.AddReference('RevitAPI')
from Autodesk.Revit.DB import *
from Autodesk.Revit.DB.Structure import *

clr.AddReference('RevitAPIUI')
from Autodesk.Revit.UI import *

clr.AddReference('System')
from System.Collections.Generic import List

clr.AddReference('RevitNodes')
import Revit
clr.ImportExtensions(Revit.GeometryConversion)
clr.ImportExtensions(Revit.Elements)

clr.AddReference('RevitServices')
import RevitServices
from RevitServices.Persistence import DocumentManager
from RevitServices.Transactions import TransactionManager

doc = DocumentManager.Instance.CurrentDBDocument
uidoc=DocumentManager.Instance.CurrentUIApplication.ActiveUIDocument

F=[]
#Preparing input from dynamo to revit
Desc = IN[0]
elements = IN[1]

for D,E in zip(Desc,elements):
	if "Type Mark" in D:
		F.append(E)
#Do some action in a Transaction
TransactionManager.Instance.EnsureInTransaction(doc)

TransactionManager.Instance.TransactionTaskDone()

OUT = F
# ----------------------------------------
code_block_5 = CodeBlock { "Type Mark"; }
code_block_6 = CodeBlock { "Type Mark"; }
getParameterValueByName_2 = Element.GetParameterValueByName(element=python_script_2, parameterName=code_block_6)
length_2 = String.Length(str=getParameterValueByName_2)
code_block_7 = CodeBlock { 1; }
count_2 = List.Count(list=getParameterValueByName_2@L2)
range_2 = Range(start=code_block_7, end=count_2)
code_block_8 = CodeBlock(L=range_2) { -L; }
string_from_object_2 = FromObject(obj=code_block_8)
insert_2 = String.Insert(str=getParameterValueByName_2, index=length_2, toInsert=string_from_object_2)
setParameterByName_2 = Element.SetParameterByName(element=python_script_2, parameterName=code_block_5, value=insert_2)
string = StringInput("RVT Links")
byName = Category.ByName(name=string)
all_elements_of_category = ElementsOfCategory(Category=byName)
isPinned = Element.IsPinned(element=all_elements_of_category)
boolean = BoolSelector(true)
setPinnedStatus = Element.SetPinnedStatus(element=all_elements_of_category, pinned=boolean)
string_2 = StringInput("Levels")
byName_2 = Category.ByName(name=string_2)
all_elements_of_category_2 = ElementsOfCategory(Category=byName_2)
boolean_2 = BoolSelector(true)
setPinnedStatus_2 = Element.SetPinnedStatus(element=all_elements_of_category_2, pinned=boolean_2)
isPinned_2 = Element.IsPinned(element=all_elements_of_category_2)
string_3 = StringInput("Grids")
byName_3 = Category.ByName(name=string_3)
all_elements_of_category_3 = ElementsOfCategory(Category=byName_3)
boolean_3 = BoolSelector(true)
setPinnedStatus_3 = Element.SetPinnedStatus(element=all_elements_of_category_3, pinned=boolean_3)
isPinned_3 = Element.IsPinned(element=all_elements_of_category_3)

# group: there are id
all_warnings_of_type_2 = AllWarningsOfType("""There are identical instances in the same place. This will result 
in double counting in schedules. """)
getFailingElements_2 = Warning.GetFailingElements(warning=all_warnings_of_type_2)
python_script_3 = Python(IN[0]=getFailingElements_2)
# ---------- python_script_3.python (60 lines) ----------
import clr

clr.AddReference('RevitAPI')
from Autodesk.Revit.DB import *
from Autodesk.Revit.DB.Structure import *

clr.AddReference('RevitAPIUI')
from Autodesk.Revit.UI import *

clr.AddReference('System')
from System.Collections.Generic import List

clr.AddReference('RevitNodes')
import Revit
clr.ImportExtensions(Revit.GeometryConversion)
clr.ImportExtensions(Revit.Elements)

clr.AddReference('RevitServices')
import RevitServices
from RevitServices.Persistence import DocumentManager
from RevitServices.Transactions import TransactionManager

doc = DocumentManager.Instance.CurrentDBDocument
uidoc=DocumentManager.Instance.CurrentUIApplication.ActiveUIDocument
#Do some action in a Transaction
TransactionManager.Instance.EnsureInTransaction(doc)

#Dimension From Wall Centerlines?
TD=TaskDialog("Duplicate Elements")
TD.Title="Duplicate Elements"
TD.MainIcon=TaskDialogIcon.TaskDialogIconShield
TD.MainInstruction = "Do you want to delete duplicated element (Yes) or isolate them to be checked (No)?"
TD.CommonButtons = TaskDialogCommonButtons.Yes | TaskDialogCommonButtons.No
#TD.ExtraCheckBoxText="Isolate Failed Columns?"
result=TD.Show()

#Preparing input from dynamo to revit
elements = UnwrapElement(IN[0])
AV= doc.ActiveView

if result == TaskDialogResult.Yes:
	for e in elements:
		try:
			e0=e[0]
			e1=e[1]
			doc.Delete(e1.Id)
		except:
			pass
else:
	elements=[item for sublist in elements for item in sublist]
	L=[i.Id for i in elements]
	for e in elements:
		IL= List[ElementId](L)
		AV.IsolateElementsTemporary(IL)



TransactionManager.Instance.TransactionTaskDone()

OUT = "Done"
# ----------------------------------------

boolean_4 = BoolSelector(true)
moveToRoomLocation = Custom[RoomTag.MoveToRoomLocation](update=boolean_4)  # package ParametricMonkey; Moves room tags to the room location point. Use the Room.CentreLocation node first before using this node. Based on the script by Modelical. Tutorial: https://parametricmonkey.com/2016/01/21/room-centre-location/
