# Dynamo graph 03 create workset.dyn (Dynamo 2.19.3.6394)

create_workset = Python()  # CPython3; unwired: IN[0]
# ---------- create_workset.python (30 lines) ----------
import clr
clr.AddReference("RevitAPI")
clr.AddReference("RevitServices")
from Autodesk.Revit.DB import *
from RevitServices.Persistence import DocumentManager
from RevitServices.Transactions import TransactionManager

# الوثيقة الحالية
doc = DocumentManager.Instance.CurrentDBDocument

# قائمة بأسماء Worksets المطلوبة
required_worksets = ["Z_Temporary", "Z_Shared Levels and Grids", "Z_Link_ID "]  # عدّل حسب الحاجة

# جلب جميع Worksets الحالية
current_worksets = [ws.Name for ws in FilteredWorksetCollector(doc).OfKind(WorksetKind.UserWorkset)]

# بدء عملية تحرير
TransactionManager.Instance.EnsureInTransaction(doc)

# إنشاء Worksets الناقصة
for workset_name in required_worksets:
    if workset_name not in current_worksets:
        try:
            Workset.Create(doc, workset_name)
            print(f"تم إنشاء Workset: {workset_name}")
        except Exception as e:
            print(f"خطأ أثناء إنشاء {workset_name}: {e}")

# إنهاء العملية
TransactionManager.Instance.TransactionTaskDone()
# ----------------------------------------
pin_all_levels = Python()  # CPython3; unwired: IN[0]
# ---------- pin_all_levels.python (39 lines) ----------
import clr
clr.AddReference('RevitAPI')
clr.AddReference('RevitServices')
clr.AddReference('RevitAPIUI')
clr.AddReference('RevitNodes')

from Autodesk.Revit.DB import *
from RevitServices.Persistence import DocumentManager
from RevitServices.Transactions import TransactionManager

# الحصول على المستند الحالي
doc = DocumentManager.Instance.CurrentDBDocument

# وظيفة لتثبيت العنصر (Pin)
def pin_element(element):
    if not element.Pinned:
        element.Pinned = True

# جمع الروابط، الشبكات، المستويات، و Scope Boxes
def collect_and_pin_elements(doc):
    # روابط Revit
    links = FilteredElementCollector(doc).OfClass(RevitLinkInstance).ToElements()
    # الشبكات
    grids = FilteredElementCollector(doc).OfClass(Grid).ToElements()
    # المستويات
    levels = FilteredElementCollector(doc).OfClass(Level).ToElements()
    # Scope Boxes
    scope_boxes = FilteredElementCollector(doc).OfCategory(BuiltInCategory.OST_VolumeOfInterest).ToElements()

    elements = links + grids + levels + scope_boxes

    # بدء المعاملة
    TransactionManager.Instance.EnsureInTransaction(doc)
    for elem in elements:
        pin_element(elem)
    TransactionManager.Instance.TransactionTaskDone()

# تنفيذ الوظيفة
collect_and_pin_elements(doc)
# ----------------------------------------
python_script = Python()  # CPython3; unwired: IN[0]
# ---------- python_script.python (35 lines) ----------
import clr
clr.AddReference('RevitAPI')
clr.AddReference('RevitServices')
from Autodesk.Revit.DB import Workset, WorksetKind, FilteredElementCollector
from RevitServices.Persistence import DocumentManager
from RevitServices.Transactions import TransactionManager

# الحصول على المستند الحالي
doc = DocumentManager.Instance.CurrentUIApplication.ActiveUIDocument.Document

# الحصول على الاختيار من المستخدم في Dynamo Player
discipline_value = IN[0]  # المستخدم يختار من DropDown في Dynamo Player

# تحديد اسم Workset بناءً على قيمة الاختيار
if discipline_value == "معماري":
    workset_name = "Workset_معماري"
elif discipline_value == "ميكانيكا":
    workset_name = "Workset_ميكانيكا"
else:
    workset_name = "Workset_آخر"

# الحصول على Worksets الموجودة باستخدام FilteredElementCollector
existing_worksets = FilteredElementCollector(doc).OfClass(Workset).ToElements()

# استخراج أسماء الـ Worksets الموجودة
workset_names = [workset.Name for workset in existing_worksets]

# التحقق وإنشاء Workset إذا لم يكن موجودًا
if workset_name not in workset_names:
    TransactionManager.Instance.EnsureInTransaction(doc)
    Workset.Create(doc, workset_name)
    TransactionManager.Instance.TransactionTaskDone()
    OUT = f"تم إنشاء Workset جديد: {workset_name}"
else:
    OUT = f"الـ Workset '{workset_name}' موجود بالفعل."
# ----------------------------------------
