# Dynamo graph 04 duplicate Warnings.dyn "duplicate Warnings" (Dynamo 2.10.1.3976)

all_warnings_of_type = AllWarningsOfType("""There are identical instances in the same place. This will result 
in double counting in schedules. """)
getFailingElements = Warning.GetFailingElements(warning=all_warnings_of_type)
python_script = Python(IN[0]=getFailingElements)  # IronPython2
# ---------- python_script.python (60 lines) ----------
import clr

clr.AddReference('RevitAPI')
from Autodesk.Revit.DB import *
from Autodesk.Revit.DB.Structure import *

clr.AddReference('RevitAPIUI')
from Autodesk.Revit.UI import *

clr.AddReference('System')
from System.Collections.Generic import List

clr.AddReference('RevitNodes')
import Revit
clr.ImportExtensions(Revit.GeometryConversion)
clr.ImportExtensions(Revit.Elements)

clr.AddReference('RevitServices')
import RevitServices
from RevitServices.Persistence import DocumentManager
from RevitServices.Transactions import TransactionManager

doc = DocumentManager.Instance.CurrentDBDocument
uidoc=DocumentManager.Instance.CurrentUIApplication.ActiveUIDocument
#Do some action in a Transaction
TransactionManager.Instance.EnsureInTransaction(doc)

#Dimension From Wall Centerlines?
TD=TaskDialog("Duplicate Elements")
TD.Title="Duplicate Elements"
TD.MainIcon=TaskDialogIcon.TaskDialogIconShield
TD.MainInstruction = "Do you want to delete duplicated element (Yes) or isolate them to be checked (No)?"
TD.CommonButtons = TaskDialogCommonButtons.Yes | TaskDialogCommonButtons.No
#TD.ExtraCheckBoxText="Isolate Failed Columns?"
result=TD.Show()

#Preparing input from dynamo to revit
elements = UnwrapElement(IN[0])
AV= doc.ActiveView

if result == TaskDialogResult.Yes:
	for e in elements:
		try:
			e0=e[0]
			e1=e[1]
			doc.Delete(e1.Id)
		except:
			pass
else:
	elements=[item for sublist in elements for item in sublist]
	L=[i.Id for i in elements]
	for e in elements:
		IL= List[ElementId](L)
		AV.IsolateElementsTemporary(IL)



TransactionManager.Instance.TransactionTaskDone()

OUT = "Done"
# ----------------------------------------
