# Dynamo graph 05 old Ceiling To Rooms.dyn "Ceiling To Rooms" (Dynamo 2.6.1.8786)

categories = Categories("OST_Ceilings")
all_elements_of_category = ElementsOfCategory(Category=categories)
code_block = CodeBlock { "Comments"; }
categories_2 = Categories("OST_Rooms")
all_elements_of_category_2 = ElementsOfCategory(Category=categories_2)
python_script = Python(IN[0]=all_elements_of_category, IN[1]=all_elements_of_category_2)
# ---------- python_script.python (50 lines) ----------
import clr

clr.AddReference('RevitAPI')
from Autodesk.Revit.DB import *
from Autodesk.Revit.DB.Structure import *

clr.AddReference('RevitAPIUI')
from Autodesk.Revit.UI import *

clr.AddReference('System')
from System.Collections.Generic import List

clr.AddReference('RevitNodes')
import Revit
clr.ImportExtensions(Revit.GeometryConversion)
clr.ImportExtensions(Revit.Elements)

clr.AddReference('RevitServices')
import RevitServices
from RevitServices.Persistence import DocumentManager
from RevitServices.Transactions import TransactionManager


doc = DocumentManager.Instance.CurrentDBDocument
uidoc=DocumentManager.Instance.CurrentUIApplication.ActiveUIDocument

#Do some action in a Transaction
TransactionManager.Instance.EnsureInTransaction(doc)


L=[]
#Preparing input from dynamo to revit
Ceilings = UnwrapElement(IN[0])
Rooms = UnwrapElement(IN[1])
for C in Ceilings:
	BottomCeiling= C.GetGeometryObjectFromReference(HostObjectUtils.GetBottomFaces(C)[0])
	for R in Rooms:
		RoomVolume=R.ClosedShell
		Centroid=[i.ComputeCentroid() for i in RoomVolume][0]
		try:
			Check=BottomCeiling.Project(Centroid).XYZPoint
			L.append(R)
		except:
			L.append(None)
		#Pt=


TransactionManager.Instance.TransactionTaskDone()

OUT = L
# ----------------------------------------
code_block_2 = CodeBlock { "Number"; }
getParameterValueByName = Element.GetParameterValueByName(element=python_script, parameterName=code_block_2)
setParameterByName = Element.SetParameterByName(element=all_elements_of_category, parameterName=code_block, value=getParameterValueByName)
