# Dynamo graph 06 Ceiling To Rooms.dyn "Ceiling To Rooms" (Dynamo 2.6.1.8786)
# packages: Data-Shapes 2022.2.98

# group: Preparing Inputs
code_block = CodeBlock { "Ceilings"; "Please Select the Ceilings"; }
categories = Categories("OST_Ceilings")
selectmodelelements_data = Custom[SelectModelElements Data](InputName=code_block.out0, ButtonText=code_block.out1, CategoryFilter=categories)  # package Data-Shapes; Creates a Revit element selection input for UI.MultipleInputForm++ . Check out www.data-shapes.net for more infos!
code_block_2 = CodeBlock { "Rooms Parameter"; "Please Type The Room Parameter Name"; }
categories_2 = Categories("OST_Rooms")
all_elements_of_category = ElementsOfCategory(Category=categories_2)
code_block_3 = CodeBlock(L=all_elements_of_category) { L[0]; }
parameters = Element.Parameters(element=code_block_3)
string_from_object = FromObject(obj=parameters)
code_block_4 = CodeBlock { " :"; }
split = String.Split(str=string_from_object, separator0=code_block_4)
firstItem = List.FirstItem(list=split@L2)
dropdown_data = Custom[DropDown Data](InputName=code_block_2.out0, Keys=firstItem, Values=firstItem)  # package Data-Shapes; Create data for DropDown input in UI.MultiInputForm ++ . Check out www.data-shapes.net for more infos.
code_block_5 = CodeBlock { "Ceilings Parameter"; "Please Type The Ceilings Parameter Name"; }
categories_3 = Categories("OST_Ceilings")
all_elements_of_category_2 = ElementsOfCategory(Category=categories_3)
code_block_6 = CodeBlock(L=all_elements_of_category_2) { L[0]; }
parameters_2 = Element.Parameters(element=code_block_6)
string_from_object_2 = FromObject(obj=parameters_2)
code_block_7 = CodeBlock { " :"; }
split_2 = String.Split(str=string_from_object_2, separator0=code_block_7)
firstItem_2 = List.FirstItem(list=split_2@L2)
dropdown_data_2 = Custom[DropDown Data](InputName=code_block_5.out0, Keys=firstItem_2, Values=firstItem_2)
list_create = List.Create(item0=selectmodelelements_data, item1=dropdown_data, item2=dropdown_data_2)

# group: Data Shape Preparation
code_block_8 = CodeBlock { "Ceilings Parameters By Rooms"; }
file_path = Filename("..\..\..\..\..\..\..\Logo.png")
code_block_9 = CodeBlock { "RUN"; }
boolean = BoolSelector(true)
code_block_10 = CodeBlock { "Cancel"; }
code_block_11 = CodeBlock { 1000; 500; 200; }
multipleinputform = Custom[MultipleInputForm ++](Description_optional=code_block_8, Logo_optional=file_path, ButtonText_optional=code_block_9, Inputs=list_create, Toggle=boolean, CancelButtonText_optional=code_block_10, MaxHeight_optional=code_block_11.out0, Width_optional=code_block_11.out1, LabelWidth_optional=code_block_11.out2)  # package Data-Shapes; Create a form with multiple inputs. see www.data-shapes.net for tutorials and infos!

# group: Distribute the Inputs
code_block_12 = CodeBlock { 0; 1; 2; }
getItemAtIndex = List.GetItemAtIndex(list=multipleinputform.User_Inputs, index=code_block_12.out0)
getItemAtIndex_2 = List.GetItemAtIndex(list=multipleinputform.User_Inputs, index=code_block_12.out1)
getItemAtIndex_3 = List.GetItemAtIndex(list=multipleinputform.User_Inputs, index=code_block_12.out2)

# group: The Magic
python_script = Python(IN[0]=getItemAtIndex, IN[1]=getItemAtIndex_2, IN[2]=getItemAtIndex_3)
# ---------- python_script.python (197 lines) ----------
import clr

clr.AddReference('RevitAPI')
from Autodesk.Revit.DB import *
from Autodesk.Revit.DB.Structure import *

clr.AddReference('RevitAPIUI')
from Autodesk.Revit.UI import *

clr.AddReference('System')
from System.Collections.Generic import List

clr.AddReference('RevitNodes')
import Revit
clr.ImportExtensions(Revit.GeometryConversion)
clr.ImportExtensions(Revit.Elements)

clr.AddReference('RevitServices')
import RevitServices
from RevitServices.Persistence import DocumentManager
from RevitServices.Transactions import TransactionManager

import itertools

doc = DocumentManager.Instance.CurrentDBDocument
uidoc=DocumentManager.Instance.CurrentUIApplication.ActiveUIDocument

TransactionManager.Instance.EnsureInTransaction(doc)

#Preparing input from dynamo to revit
Rooms=FilteredElementCollector(doc).OfCategory(BuiltInCategory.OST_Rooms).WhereElementIsNotElementType().	ToElements()

#Checking for Valid Rooms (Excluding Redundant & Unlocated Rooms)
ValidRooms=[]
for R in Rooms:
	if round(R.Area,2)!=0:
		ValidRooms.append(R)

#Checking Lists Type For Ceilings Input
if not isinstance(IN[0],list):
	Ceilings = UnwrapElement([IN[0]])
else:
	Ceilings = UnwrapElement(IN[0])

#Ceilings as Ids
CeilingsIds=[i.Id for i in Ceilings]
#A Copy Of Ceiling List
CopyCeilings=[i for i in Ceilings]

#Room Parameter Name
RPN= IN[1]
#Ceiling Parameter Name
CPN= IN[2]

#Geometry Option
Opt= Options()
Opt.ComputeReferences=True
Opt.IncludeNonVisibleObjects=True

#Solid-Curve Intersection Option
SCIO=SolidCurveIntersectionOptions()

#Preparing Needed Lists
PassedCeilings=[]
CeilingsWithNoRoom=[]
FailedCeilings=[]
FailedRooms=[]

#Iterating Through Valid Rooms
for R in ValidRooms:
	# try:
	#Room Geometry
	RGeo=R.get_Geometry(Opt)
	#Room Solid Geometry
	RSol=[i for i in RGeo][0]
	
	#Iterating Through Ceilings
	for j,C in enumerate(Ceilings):
		# try:
		PointsToDrop=[]
		#Checking Built-In Ceilings
		if str(C.LevelId)!="-1":
			#Getting Ceiling's Bottom Face Reference
			BottomFaceRef=HostObjectUtils.GetBottomFaces(C)
			#Iterating Through Bottom Face Array
			for B in BottomFaceRef:
				#Getting the Bottom Face As Geometry
				CBottomFace=C.GetGeometryObjectFromReference(B)
				#Getting the Curve Loops Of the Bottom Face
				ECs=CBottomFace.GetEdgesAsCurveLoops()
				#Iterating Through Curve Loops (To Consider That the Ceiling May Have Multiple Bottom Faces)
				for n in ECs:
					#The Following Steps Aim To Get Multiple Points On Different Locations On the Ceiling's Face To Check For Rooms Below Them
					#Combining Every Two Curves Of the Curve Loop Array
					for v,x in itertools.combinations(n,2):
						#Middle Of the First Curve
						p1=v.Evaluate(0.5,True)
						#Middle Of the Second Curve
						p2=x.Evaluate(0.5,True)
						#Line Between the Two Middles
						Lino=Line.CreateBound(p1,p2)
						#Middl OF the Line
						p3=Lino.Evaluate(0.5,True)
						#Check Whether the Middle Of the Line Is On the Ceiling Face
						if CBottomFace.Project(p3):
							#If yes, Add It to the PointsToDrop List
							PointsToDrop.append(p3)

		#Checking Non Built-In Ceilings (Ceiling Made As Components)
		elif str(C.LevelId)=="-1":
			#Ceiling Geometry
			CGeo=C.get_Geometry(Opt)
			#Ceiling Geometry Elements
			CGeo=[i for i in CGeo]
			#Iterating Through Geometry Elements To Get the Real Solid Geometry
			for i in CGeo:
				#If the Geometry Element Is Geometry Instance
				if isinstance (i,GeometryInstance):
					#Getting the Instance Geometries
					InstanceGeometry=i.GetInstanceGeometry()
					#Iterating Through Instance Geometries To Get the Real One
					for k in InstanceGeometry:
						#Check For Solids With Reasonable Volume
						if isinstance(k,Solid) and round(k.Volume,2)>0:
							#If Found, Assign For CSol Variable
							CSol=k
				#If the Geometry Element Is Solid With Reasonable Volume
				elif isinstance(i,Solid) and round(i.Volume,2)>0:
					#Assign For CSol Variable 
					CSol=i
			#Iterating Through the Solid's Faces		
			T=0
			for F in CSol.Faces:
				#Check Whether the Centroid Of the Ceiling Solid Is Under One Of the Solid's Faces
				if F.Project(CSol.ComputeCentroid()):
					T=1
			#If T=1, The Centroid Is Under At Least One Face.
			if T==1:
				#Add The Centroid to the PointsToDrop List
				PointsToDrop.append(CSol.ComputeCentroid())

		#Getting the PointsTo Drop As Dynamo Points
		PointsToDropDyn=[i.ToPoint() for i in PointsToDrop]
		
		#Iterating Through PointsToDrops
		for P in PointsToDrop:
			#Translatin The Points Vertically Down To Create A Line
			Pt2= Transform.CreateTranslation(-1.5*XYZ.BasisZ).OfPoint(P)
			Line=Line.CreateBound(P,Pt2)
			#Check Intersection Between the Line and the Room Solid Geometry
			Check=RSol.IntersectWithCurve(Line,SCIO)
			#If Yes, Assign the Values From the Defined Room Parameter To the Defined Ceiling Parameter.
			if Check.SegmentCount>0:
				CPara=C.GetParameters(CPN)[0]
				CPara.Set(R.GetParameters(RPN)[0].AsString())
				#Add the Ceiling To the Passed Ceilings List
				PassedCeilings.append(C.Id)
	# 		except:
	# 			FailedCeilings.append(C)
	# except:
	# 	FailedRooms.append(R)	

#Iterating Through Ceilings List to Get The Ceiling With No Room Found Below.
for C in Ceilings:				
	if not C.Id in PassedCeilings:
		CeilingsWithNoRoom.append(C)

if FailedRooms:
	TD=TaskDialog("Rooms Errors")
	TD.Title="Rooms Errors"
	TD.MainIcon=TaskDialogIcon.TaskDialogIconWarning
	TD.MainInstruction = "Some Rooms Have Errors!"
	#TD.CommonButtons = TaskDialogCommonButtons.Yes | TaskDialogCommonButtons.No
	#TD.ExtraCheckBoxText="Isolate Failed Columns?"
	result=TD.Show()

if FailedCeilings:
	TD=TaskDialog("Ceilings Errors")
	TD.Title="Ceilings Errors"
	TD.MainIcon=TaskDialogIcon.TaskDialogIconWarning
	TD.MainInstruction = "Some Ceilings Have Errors!"
	#TD.CommonButtons = TaskDialogCommonButtons.Yes | TaskDialogCommonButtons.No
	#TD.ExtraCheckBoxText="Isolate Failed Columns?"
	result=TD.Show()

if CeilingsWithNoRoom:
	TD=TaskDialog("Ceilings With No Related Room")
	TD.Title="Ceilings With No Related Room"
	TD.MainIcon=TaskDialogIcon.TaskDialogIconWarning
	TD.MainInstruction = "There Are "+str(CeilingsWithNoRoom.Count)+" Ceilings With No Related Room!"
	#TD.CommonButtons = TaskDialogCommonButtons.Yes | TaskDialogCommonButtons.No
	#TD.ExtraCheckBoxText="Isolate Failed Columns?"
	result=TD.Show()

TransactionManager.Instance.TransactionTaskDone()

OUT = FailedRooms,FailedCeilings,CeilingsWithNoRoom
# ----------------------------------------
