# Dynamo graph 07-GET-WALL-FLOOR-CEILING-TYPES-SET-TO-ROOM-PARAMETERS.dyn "DONE-GET-WALL-FLOOR-CEILING-TYPES-SET-TO-ROOM-PARAMETERS" (Dynamo 2.6.1.8786)
# packages: archi-lab.net 2023.213.1722, Genius Loci 2022.8.5, Filter by string 0.71.2, DynaMEP 1.2.8, designtech 1.0.8

# group: Ceiling
categories = Categories("OST_Ceilings")
all_elements_of_category = ElementsOfCategory(Category=categories)
solids = Element.Solids(element=all_elements_of_category)
centroid = Solid.Centroid(solid=solids)
flatten = List.Flatten(list=centroid)
ZAxis = Vector.ZAxis()
code_block = CodeBlock { -1000; }
translate = Geometry.Translate(geometry=flatten, direction=ZAxis, distance=code_block)
boolean = BoolSelector(true)
python_script = Python(IN[0]=translate, IN[1]=boolean)
# ---------- python_script.python (53 lines) ----------
import clr

clr.AddReference('ProtoGeometry')
clr.AddReference("RevitAPI")
clr.AddReference("RevitServices")
clr.AddReference("RevitNodes")

import RevitServices
import Revit

clr.ImportExtensions(Revit.GeometryConversion)

from RevitServices.Persistence import DocumentManager

doc = DocumentManager.Instance.CurrentDBDocument

points = UnwrapElement(IN[0])
toggle = IN[1]
lst = []

##########

if toggle == True:
	for point in points:
		try:
			room = doc.GetRoomAtPoint(point.ToXyz())
			lst.append(room.LookupParameter("Number").AsString())
		except:
			lst.append("No Room")

	OUT = lst
	
else:
	pass
	
	OUT = "Set toogle to True"














			#lst.apppend(DB.Element.Name.GetValue(room))
			#lst.append(room.get_Parameter('Name').AsString())
		
# ----------------------------------------

# group: Filter out Ceilings without rooms
string = StringInput("No Room")
eq = python_script == string
filterByBoolMask = List.FilterByBoolMask(list=python_script, mask=eq)
filterByBoolMask_2 = List.FilterByBoolMask(list=all_elements_of_category, mask=eq)

# group: set ceiling type to room parameter"Ceiling Finish"
room_byname = Custom[Room ByName](NameOrNumber=filterByBoolMask.out)  # package Genius Loci; Enter the room/space name or number to get the room.
uniqueItems = List.UniqueItems(list=room_byname.Rooms)
ceiling_room_name_parameter = StringInput("Ceiling Finish")
name = Element.Name(element=filterByBoolMask_2.out)
setParameterByName = Element.SetParameterByName(element=uniqueItems, parameterName=ceiling_room_name_parameter, value=name)

roomsByStatus = dtRevit.Collector.RoomsByStatus()
watch = Watch(roomsByStatus.placed)

# group: WALLS-to be verified
boundaries = Custom[Room.Boundaries](room=watch)  # package archi-lab.net; This node returns all Room bounding curves and elements that generated them (walls, separation lines etc).
code_block_2 = CodeBlock { "Wall"; }
filter_by_string = Custom[Filter by string](list=boundaries.element@L2, String=code_block_2)  # package Filter by string; Filter a list by a string match
get_compoundstructurelayers = Custom[Get CompoundStructureLayers](ElementOrFamilyType=filter_by_string.Match@L2)  # package Genius Loci; Retrieves the properties of the compound layers of wall, floor, roof or ceiling Type.
code_block_3 = CodeBlock { 1; }
flatten_2 = List.Flatten(list=get_compoundstructurelayers.Material@L3, amt=code_block_3)
groupByKey = List.GroupByKey(list=flatten_2, keys=watch)
code_block_4 = CodeBlock { "Wall Finish"; }
code_block_5 = CodeBlock { "+"; }
name_2 = Material.Name(material=flatten_2@L2)
uniqueItems_2 = List.UniqueItems(list=name_2@L2)
join = String.Join(separator=code_block_5, string0=uniqueItems_2)

setParameterValueByName = RevitModel.Element.SetParameterValueByName(element=groupByKey.unique_keys, parameterName=code_block_4, values=join@L2)

# group: SET FLOOR TYPE NAME TO ROOM FLOOR FINISH PARAMETER
code_block_6 = CodeBlock { "+"; }
code_block_7 = CodeBlock { "Floor"; }
filter_by_string_2 = Custom[Filter by string](list=filter_by_string.Other@L2, String=code_block_7)
name_3 = FamilyType.Name(familyType=filter_by_string_2.Match)
uniqueItems_3 = List.UniqueItems(list=name_3@L2)
join_2 = String.Join(separator=code_block_6, string0=uniqueItems_3@L2)
code_block_8 = CodeBlock { "Floor Finish"; }

flatten_3 = List.Flatten(list=join_2)

# group (continued): SET FLOOR TYPE NAME TO ROOM FLOOR FINISH PARAMETER
groupByKey_2 = List.GroupByKey(list=flatten_3, keys=watch)

flatten_4 = List.Flatten(list=groupByKey_2.groups)
setParameterValueByName_2 = RevitModel.Element.SetParameterValueByName(element=groupByKey_2.unique_keys, parameterName=code_block_8, values=flatten_4)
show_element = Custom[Show Element]()  # package Genius Loci; Shows the given elements by zoom to fit in a view and select them.; unwired: element
watch_2 = Watch(solids)
