# Dynamo graph 07.1 DONE-UI.GET-SET-WALL-FLOOR-CEILING-TYPES-SET-TO-ROOM-PARAMETERS-AND-CREATE-SCEDULE.dyn "DONE-UI.GET-SET-WALL-FLOOR-CEILING-TYPES-SET-TO-ROOM-PARAMETERS-AND-CREATE-SCEDULE-AND-EXPORT-TO-EXCEL" (Dynamo 2.6.1.8786)
# packages: archi-lab.net 2023.213.1722, Genius Loci 2022.8.5, Filter by string 0.71.2, designtech 1.0.8, ConnectedDesign 0.1.7, DynaMEP 1.2.8, Data-Shapes 2023.2.111, bimorphNodes 4.2.1

roomsByStatus = dtRevit.Collector.RoomsByStatus()
watch = Watch(roomsByStatus.placed)

# group: SET FLOOR TYPE NAME TO ROOM FLOOR FINISH PARAMETER
code_block = CodeBlock { "+"; }
boundaries = Custom[Room.Boundaries](room=watch)  # package archi-lab.net; This node returns all Room bounding curves and elements that generated them (walls, separation lines etc).
code_block_2 = CodeBlock { "Floor"; }
filter_by_string = Custom[Filter by string](list=boundaries.element@L2, String=code_block_2)  # package Filter by string; Filter a list by a string match
name = FamilyType.Name(familyType=filter_by_string.Match)
uniqueItems = List.UniqueItems(list=name@L2)
join = String.Join(separator=code_block, string0=uniqueItems@L2)
flatten = List.Flatten(list=join)
groupByKey = List.GroupByKey(list=flatten, keys=watch)
code_block_3 = CodeBlock { "Floor Finish"; }

new_floor_values = Watch(flatten)

# group: Ceiling
categories = Categories("OST_Ceilings")
all_elements_of_category = ElementsOfCategory(Category=categories)
solids = Element.Solids(element=all_elements_of_category)
centroid = Solid.Centroid(solid=solids)
flatten_2 = List.Flatten(list=centroid)
ZAxis = Vector.ZAxis()
code_block_4 = CodeBlock { -1000; }
translate = Geometry.Translate(geometry=flatten_2, direction=ZAxis, distance=code_block_4)
boolean = BoolSelector(true)
python_script = Python(IN[0]=translate, IN[1]=boolean)
# ---------- python_script.python (53 lines) ----------
import clr

clr.AddReference('ProtoGeometry')
clr.AddReference("RevitAPI")
clr.AddReference("RevitServices")
clr.AddReference("RevitNodes")

import RevitServices
import Revit

clr.ImportExtensions(Revit.GeometryConversion)

from RevitServices.Persistence import DocumentManager

doc = DocumentManager.Instance.CurrentDBDocument

points = UnwrapElement(IN[0])
toggle = IN[1]
lst = []

##########

if toggle == True:
	for point in points:
		try:
			room = doc.GetRoomAtPoint(point.ToXyz())
			lst.append(room.LookupParameter("Number").AsString())
		except:
			lst.append("No Room")

	OUT = lst
	
else:
	pass
	
	OUT = "Set toogle to True"














			#lst.apppend(DB.Element.Name.GetValue(room))
			#lst.append(room.get_Parameter('Name').AsString())
		
# ----------------------------------------

# group: Filter out Ceilings without rooms
string = StringInput("No Room")
eq = python_script == string
filterByBoolMask = List.FilterByBoolMask(list=python_script, mask=eq)
filterByBoolMask_2 = List.FilterByBoolMask(list=all_elements_of_category, mask=eq)

# group: set ceiling type to room parameter"Ceiling Finish"
room_byname = Custom[Room ByName](NameOrNumber=filterByBoolMask.out)  # package Genius Loci; Enter the room/space name or number to get the room.
uniqueItems_2 = List.UniqueItems(list=room_byname.Rooms)
ceiling_room_name_parameter = StringInput("Ceiling Finish")
name_2 = Element.Name(element=filterByBoolMask_2.out)

getParameterValueByName = Element.GetParameterValueByName(element=uniqueItems_2, parameterName=ceiling_room_name_parameter)
new_ceiling_values = Watch(name_2)

# group: CEILING FINISH
code_block_5 = CodeBlock { "EXISTING VALUES"; "NEW CREATED VALUES"; }
treeview_input = Custom[TreeView input](InputName=code_block_5.out0@L1, Data=getParameterValueByName)  # package Data-Shapes
treeview_input_2 = Custom[TreeView input](InputName=code_block_5.out1@L1, Data=new_ceiling_values)
list_create = List.Create(item0=treeview_input, item1=treeview_input_2)
flatten_3 = List.Flatten(list=list_create)

# group: VISUALLY CHOOSE THEN SELECT VALUES TO KEEP
code_block_6 = CodeBlock { "CEILING-FINISH-VISUALLY CHOOSE VALUES TO KEEP AND HIT RUN"; "Run Button"; "Cancel Button"; 1800; 300; }
boolean_2 = BoolSelector(true)
multipleinputform = Custom[MultipleInputForm ++](Description_optional=code_block_6.out0, ButtonText_optional=code_block_6.out1, Inputs=flatten_3, Toggle=boolean_2, CancelButtonText_optional=code_block_6.out2, Width_optional=code_block_6.out3, LabelWidth_optional=code_block_6.out4)  # package Data-Shapes

setParameterValueByName = RevitModel.Element.SetParameterValueByName(element=uniqueItems_2, parameterName=ceiling_room_name_parameter, values=multipleinputform.User_Inputs@L2)
code_block_7 = CodeBlock { "0-ROOM FINISHES"; }

# group: WALLS-to be verified
boundaries_2 = Custom[Room.Boundaries](room=watch)
code_block_8 = CodeBlock { "Wall"; }
filter_by_string_2 = Custom[Filter by string](list=boundaries_2.element@L2, String=code_block_8)
get_compoundstructurelayers = Custom[Get CompoundStructureLayers](ElementOrFamilyType=filter_by_string_2.Match@L2)  # package Genius Loci; Retrieves the properties of the compound layers of wall, floor, roof or ceiling Type.
code_block_9 = CodeBlock { 1; }
flatten_4 = List.Flatten(list=get_compoundstructurelayers.Material@L3, amt=code_block_9)
groupByKey_2 = List.GroupByKey(list=flatten_4, keys=watch)
code_block_10 = CodeBlock { "Wall Finish"; }
code_block_11 = CodeBlock { "+"; }
name_3 = Material.Name(material=flatten_4@L2)
uniqueItems_3 = List.UniqueItems(list=name_3@L2)
join_2 = String.Join(separator=code_block_11, string0=uniqueItems_3)

# group: WALL FINISH
code_block_12 = CodeBlock { "EXISTING VALUES"; "NEW CREATED VALUES"; }
getParameterValueByName_2 = Element.GetParameterValueByName(element=groupByKey_2.unique_keys@L1, parameterName=code_block_10)
treeview_input_3 = Custom[TreeView input](InputName=code_block_12.out0@L1, Data=getParameterValueByName_2)
new_wall_values = List.Flatten(list=join_2)
treeview_input_4 = Custom[TreeView input](InputName=code_block_12.out1@L1, Data=new_wall_values)
list_create_2 = List.Create(item0=treeview_input_3, item1=treeview_input_4)
flatten_5 = List.Flatten(list=list_create_2)

# group: VISUALLY CHOOSE THEN SELECT VALUES TO KEEP
code_block_13 = CodeBlock { "WALL-FINISH-VISUALLY CHOOSE VALUES TO KEEP AND HIT RUN"; "Run Button"; "Cancel Button"; 1800; 300; }
boolean_3 = BoolSelector(true)
multipleinputform_2 = Custom[MultipleInputForm ++](Description_optional=code_block_13.out0, ButtonText_optional=code_block_13.out1, Inputs=flatten_5, Toggle=boolean_3, CancelButtonText_optional=code_block_13.out2, Width_optional=code_block_13.out3, LabelWidth_optional=code_block_13.out4)

setParameterValueByName_2 = RevitModel.Element.SetParameterValueByName(element=groupByKey_2.unique_keys, parameterName=code_block_10, values=multipleinputform_2.User_Inputs@L2)

# group: FLOOR FINISH
code_block_14 = CodeBlock { "EXISTING VALUES"; "NEW CREATED VALUES"; }
getParameterValueByName_3 = Element.GetParameterValueByName(element=groupByKey.unique_keys@L1, parameterName=code_block_3)
treeview_input_5 = Custom[TreeView input](InputName=code_block_14.out0@L1, Data=getParameterValueByName_3)
new_wall_values_2 = List.Flatten(list=join_2)
treeview_input_6 = Custom[TreeView input](InputName=code_block_14.out1@L1, Data=new_wall_values_2)
list_create_3 = List.Create(item0=treeview_input_5, item1=treeview_input_6)
flatten_6 = List.Flatten(list=list_create_3)

# group: VISUALLY CHOOSE THEN SELECT VALUES TO KEEP
code_block_15 = CodeBlock { "FLOOR-FINISH-VISUALLY CHOOSE VALUES TO KEEP AND HIT RUN"; "Run Button"; "Cancel Button"; 1800; 300; }
boolean_4 = BoolSelector(true)
multipleinputform_3 = Custom[MultipleInputForm ++](Description_optional=code_block_15.out0, ButtonText_optional=code_block_15.out1, Inputs=flatten_6, Toggle=boolean_4, CancelButtonText_optional=code_block_15.out2, Width_optional=code_block_15.out3, LabelWidth_optional=code_block_15.out4)

setParameterValueByName_3 = RevitModel.Element.SetParameterValueByName(element=groupByKey.unique_keys, parameterName=code_block_3, values=multipleinputform_3.User_Inputs@L2)
list_create_4 = List.Create(item0=setParameterValueByName_2, item1=setParameterValueByName_3)
flatten_7 = List.Flatten(list=list_create_4)
code_block_16 = CodeBlock { 0; }
getItemAtIndex = List.GetItemAtIndex(list=flatten_7, index=code_block_16)
getCategory = archilab.Revit.Elements.Elements.GetCategory(element=getItemAtIndex)
code_block_17 = CodeBlock { "ROOM FINISHES"; }
schedule_type = ScheduleTypes("RegularSchedule")
createSchedule = ScheduleView.CreateSchedule(category=getCategory, name=code_block_17, scheduleType=schedule_type)
schedulableFields = ScheduleView.SchedulableFields(scheduleView=createSchedule)
string_from_object = FromObject(obj=schedulableFields)
code_block_18 = CodeBlock { "Name"; "Number"; "Level"; "Wall Finish"; "Floor Finish"; "Ceiling Finish"; }
list_create_5 = List.Create(item0=code_block_18.out0, item1=code_block_18.out1, item2=code_block_18.out2, item3=code_block_18.out3, item4=code_block_18.out4, item5=code_block_18.out5)
list_CompareAndMatch = Custom[List_CompareAndMatch+](a_TakeFromList=string_from_object, b_ItemsToTake=list_create_5)  # package ConnectedDesign
getItemAtIndex_2 = List.GetItemAtIndex(list=schedulableFields, index=list_CompareAndMatch.a_Index_of_Match)
addFields = ScheduleView.AddFields(scheduleView=createSchedule, fields=getItemAtIndex_2)
getData = Revit.Schedule.GetData(scheduleView=addFields)
code_block_19 = CodeBlock { true; }
datatable_input = Custom[DataTable input](InputName=code_block_7, Data=getData, FirstRowIsTitles=code_block_19, ShowTitleAndFileInfoInExport=code_block_19, OpenExcelAtExport=code_block_19)  # package Data-Shapes

# group: CREATE ROOM FINISHING SCHEDULE AND EXPORT TO EXCEL
code_block_20 = CodeBlock { "00-ROOM FINISHES"; "Run Button"; "Cancel Button"; 1800; 300; }
boolean_5 = BoolSelector(true)
multipleinputform_4 = Custom[MultipleInputForm ++](Description_optional=code_block_20.out0, ButtonText_optional=code_block_20.out1, Inputs=datatable_input, Toggle=boolean_5, CancelButtonText_optional=code_block_20.out2, Width_optional=code_block_20.out3, LabelWidth_optional=code_block_20.out4)

end = Revit.Transaction.Transaction.End(input=multipleinputform_4.User_Inputs)
