# Dynamo graph 08 Visual Revit Warnings .dyn "08 Visual Revit Warnings" (Dynamo 2.6.1.8786)
# packages: Bang! 2021.4.3

boolean = BoolSelector(true)
getWarnings = Bang.Revit.Elements.WarningTools.GetWarnings(toggle=boolean)
color_palette = ColorPalette({R: 255, G: 0, B: 0, A: 255})
overrideColorInView = Element.OverrideColorInView(element=getWarnings.Failing_Elements, color=color_palette)
